% Simulink data dictionary Voltage_Control.sldd
% references configuration.sldd

VoltageControl_in = Simulink.Bus()
  reference: single
  measurement: single
  enable: uint16
  slewrate: single[2]

VoltageControl_out = Simulink.Bus()
  ctrlOut: single
  isAtSetpoint: uint16
  rampedSetpoint: single